# Grasshopper definition AutomateTheBoring_001.gh (Grasshopper 1.0.7)
# plug-ins: Hops

# With
# Github
# Co-Pilot!!!
panel = Panel(" Wickerson")
# Automate the Boring
# Stuff with Python
# Search for text in a file or across multiple files
# Create, update, move, and rename files and folders
# Search the Web and download online content
# Update and format data in Excel spreadsheets of any size
# Split, merge, watermark, and encrypt PDFs
# Send reminder emails and text notifications
# Fill out online forms
# Python Basics
panel_2 = Panel("Michael")
concatenate = Hops(
    String1="Michael",
    String2=panel,
    CacheResultsInMemory=True,
    CacheSolveResults=True,
    RemoteDefinitionLocation="http://127.0.0.1:5000/concatenate",
    RemoteSolveVersion=(0, 1, 0),
    ShowInput_Enabled=False,
    ShowInput_Path=False,
    SynchronousSolve=True)
hello = Hops(
    Name=panel_2,
    CacheResultsInMemory=True,
    CacheSolveResults=True,
    RemoteDefinitionLocation="http://127.0.0.1:5000/hello",
    RemoteSolveVersion=(0, 1, 0),
    ShowInput_Enabled=False,
    ShowInput_Path=False,
    SynchronousSolve=True)
cast = Hops(
    String="123456",
    CacheResultsInMemory=True,
    CacheSolveResults=True,
    RemoteDefinitionLocation="http://127.0.0.1:5000/cast",
    RemoteSolveVersion=(0, 1, 0),
    ShowInput_Enabled=False,
    ShowInput_Path=False,
    SynchronousSolve=True)
equivalence4 = Hops(
    String="123456",
    Integer="123456",
    Number="123456",
    CacheResultsInMemory=True,
    CacheSolveResults=True,
    RemoteDefinitionLocation="http://127.0.0.1:5000/equivalence4",
    RemoteSolveVersion=(0, 1, 0),
    ShowInput_Enabled=False,
    ShowInput_Path=False,
    SynchronousSolve=True)  # -> Boolean1, Boolean2
panel_3 = Panel(concatenate)
panel_4 = Panel(hello)
panel_5 = Panel(cast)
panel_6 = Panel([equivalence4.Boolean1, equivalence4.Boolean2])
# Flow Control
number_slider = Slider(1, range=0..3)
if = Hops(
    Boolean=number_slider,
    CacheResultsInMemory=True,
    CacheSolveResults=True,
    RemoteDefinitionLocation="http://127.0.0.1:5000/if",
    RemoteSolveVersion=(0, 1, 0),
    ShowInput_Enabled=False,
    ShowInput_Path=False,
    SynchronousSolve=True)
elif = Hops(
    Integer=Slider(1, range=0..3),
    CacheResultsInMemory=True,
    CacheSolveResults=True,
    RemoteDefinitionLocation="http://127.0.0.1:5000/elif",
    RemoteSolveVersion=(0, 1, 0),
    ShowInput_Enabled=False,
    ShowInput_Path=False,
    SynchronousSolve=True)
else = Hops(
    Integer=Slider(2, range=0..3),
    CacheResultsInMemory=True,
    CacheSolveResults=True,
    RemoteDefinitionLocation="http://127.0.0.1:5000/else",
    RemoteSolveVersion=(0, 1, 0),
    ShowInput_Enabled=False,
    ShowInput_Path=False,
    SynchronousSolve=True)
fizzbuzz = Hops(
    Integer=Slider(9, range=0..100),
    CacheResultsInMemory=True,
    CacheSolveResults=True,
    RemoteDefinitionLocation="http://127.0.0.1:5000/fizzbuzz",
    RemoteSolveVersion=(0, 1, 0),
    ShowInput_Enabled=False,
    ShowInput_Path=False,
    SynchronousSolve=True)
while2 = Hops(
    Integer=Slider(6, range=0..10),
    CacheResultsInMemory=True,
    CacheSolveResults=True,
    RemoteDefinitionLocation="http://127.0.0.1:5000/while2",
    RemoteSolveVersion=(0, 1, 0),
    ShowInput_Enabled=False,
    ShowInput_Path=False,
    SynchronousSolve=True)
break = Hops(
    Integer=Slider(8, range=0..10),
    CacheResultsInMemory=True,
    CacheSolveResults=True,
    RemoteDefinitionLocation="http://127.0.0.1:5000/break",
    RemoteSolveVersion=(0, 1, 0),
    ShowInput_Enabled=False,
    ShowInput_Path=False,
    SynchronousSolve=True)
for = Hops(
    Integer=Slider(10, range=0..10),
    CacheResultsInMemory=True,
    CacheSolveResults=True,
    RemoteDefinitionLocation="http://127.0.0.1:5000/for",
    RemoteSolveVersion=(0, 1, 0),
    ShowInput_Enabled=False,
    ShowInput_Path=False,
    SynchronousSolve=True)
continue = Hops(
    Integer=Slider(10, range=0..10),
    CacheResultsInMemory=True,
    CacheSolveResults=True,
    RemoteDefinitionLocation="http://127.0.0.1:5000/continue",
    RemoteSolveVersion=(0, 1, 0),
    ShowInput_Enabled=False,
    ShowInput_Path=False,
    SynchronousSolve=True)
range = Hops(
    Integer=Slider(10, range=0..10),
    CacheResultsInMemory=True,
    CacheSolveResults=True,
    RemoteDefinitionLocation="http://127.0.0.1:5000/range",
    RemoteSolveVersion=(0, 1, 0),
    ShowInput_Enabled=False,
    ShowInput_Path=False,
    SynchronousSolve=True)
rangeint = Hops(
    Start=Slider(2, range=0..10),
    Stop=Slider(10, range=0..10),
    Step=Slider(2, range=0..10),
    CacheResultsInMemory=True,
    CacheSolveResults=True,
    RemoteDefinitionLocation="http://127.0.0.1:5000/rangeInt",
    RemoteSolveVersion=(0, 1, 0),
    ShowInput_Enabled=False,
    ShowInput_Path=False,
    SynchronousSolve=True)
panel_7 = Panel(else)
panel_8 = Panel(while2)
panel_9 = Panel(if)
panel_10 = Panel(elif)
panel_11 = Panel(fizzbuzz)
panel_12 = Panel(break)
panel_13 = Panel(continue)
panel_14 = Panel(for)
panel_15 = Panel(range)
panel_16 = Panel(rangeint)
# Import Modules
number_slider_2 = Slider(0, range=-1..1)
sysexit = Hops(
    Integer=Toggle(True),
    CacheResultsInMemory=True,
    CacheSolveResults=True,
    RemoteDefinitionLocation="http://127.0.0.1:5000/sysExit",
    RemoteSolveVersion=(0, 1, 0),
    ShowInput_Enabled=False,
    ShowInput_Path=False,
    SynchronousSolve=True)
guessnumber3 = Hops(
    Integer=Slider(2, range=1..3),
    CacheResultsInMemory=False,
    CacheSolveResults=False,
    RemoteDefinitionLocation="http://127.0.0.1:5000/guessNumber3",
    RemoteSolveVersion=(0, 1, 0),
    ShowInput_Enabled=False,
    ShowInput_Path=False,
    SynchronousSolve=False)
panel_17 = Panel(sysexit)
panel_18 = Panel(guessnumber3)
# Functions
number_slider_3 = Slider(4, range=0..10)
# Exception Handling
# Command line Program
# (nonsense)
boolean_toggle = BooleanToggle(False)
callstack = Hops(
    Integer=Toggle(True),
    CacheResultsInMemory=False,
    CacheSolveResults=False,
    RemoteDefinitionLocation="http://127.0.0.1:5000/callStack",
    RemoteSolveVersion=(0, 1, 0),
    ShowInput_Enabled=False,
    ShowInput_Path=False,
    SynchronousSolve=True)
nonevalue_null = Hops(
    Integer=Slider(3, range=0..10),
    CacheResultsInMemory=True,
    CacheSolveResults=True,
    RemoteDefinitionLocation="http://127.0.0.1:5000/noneValue",
    RemoteSolveVersion=(0, 1, 0),
    ShowInput_Enabled=False,
    ShowInput_Path=False,
    SynchronousSolve=True)
keywordarguments = Hops(
    Integer=Toggle(False),
    CacheResultsInMemory=False,
    CacheSolveResults=False,
    RemoteDefinitionLocation="http://127.0.0.1:5000/keywordArguments",
    RemoteSolveVersion=(0, 1, 0),
    ShowInput_Enabled=False,
    ShowInput_Path=False,
    SynchronousSolve=True)
returnvalues = Hops(
    Integer=number_slider_3,
    CacheResultsInMemory=True,
    CacheSolveResults=True,
    RemoteDefinitionLocation="http://127.0.0.1:5000/returnValues",
    RemoteSolveVersion=(0, 1, 0),
    ShowInput_Enabled=False,
    ShowInput_Path=False,
    SynchronousSolve=True)
tryexcept2 = Hops(
    Integer=boolean_toggle,
    CacheResultsInMemory=False,
    CacheSolveResults=False,
    RemoteDefinitionLocation="http://127.0.0.1:5000/tryExcept2",
    RemoteSolveVersion=(0, 1, 0),
    ShowInput_Enabled=False,
    ShowInput_Path=False,
    SynchronousSolve=True)
localglobalscope = Hops(
    Integer=Toggle(True),
    CacheResultsInMemory=False,
    CacheSolveResults=False,
    RemoteDefinitionLocation="http://127.0.0.1:5000/localGlobalScope",
    RemoteSolveVersion=(0, 1, 0),
    ShowInput_Enabled=False,
    ShowInput_Path=False,
    SynchronousSolve=True)
zigzag = Hops(
    Integer=Toggle(False),
    CacheResultsInMemory=False,
    CacheSolveResults=False,
    RemoteDefinitionLocation="http://127.0.0.1:5000/zigzag",
    RemoteSolveVersion=(0, 1, 0),
    ShowInput_Enabled=False,
    ShowInput_Path=False,
    SynchronousSolve=True)
panel_19 = Panel(localglobalscope)
panel_20 = Panel(callstack)
panel_21 = Panel(tryexcept2)
panel_22 = Panel(returnvalues)
panel_23 = Panel(keywordarguments)
panel_24 = Panel(nonevalue_null)
# Lists
number_slider_4 = Slider(1, range=0..3)
negative = Negative(Value=number_slider_4)
list = Hops(
    Integer=number_slider_4,
    CacheResultsInMemory=False,
    CacheSolveResults=False,
    RemoteDefinitionLocation="http://127.0.0.1:5000/list",
    RemoteSolveVersion=(0, 1, 0),
    ShowInput_Enabled=False,
    ShowInput_Path=False,
    SynchronousSolve=True)
del = Hops(
    Integer=Slider(0, range=0..3),
    CacheResultsInMemory=False,
    CacheSolveResults=False,
    RemoteDefinitionLocation="http://127.0.0.1:5000/del",
    RemoteSolveVersion=(0, 1, 0),
    ShowInput_Enabled=False,
    ShowInput_Path=False,
    SynchronousSolve=True)
concatenation = Hops(
    Integer=Toggle(False),
    CacheResultsInMemory=True,
    CacheSolveResults=True,
    RemoteDefinitionLocation="http://127.0.0.1:5000/concatenation",
    RemoteSolveVersion=(0, 1, 0),
    ShowInput_Enabled=False,
    ShowInput_Path=False,
    SynchronousSolve=True)
length3 = Hops(
    Integer=Slider(0, range=0..3),
    CacheResultsInMemory=True,
    CacheSolveResults=True,
    RemoteDefinitionLocation="http://127.0.0.1:5000/length3",
    RemoteSolveVersion=(0, 1, 0),
    ShowInput_Enabled=False,
    ShowInput_Path=False,
    SynchronousSolve=True)
changevalue = Hops(
    Integer=Slider(0, range=0..3),
    CacheResultsInMemory=True,
    CacheSolveResults=True,
    RemoteDefinitionLocation="http://127.0.0.1:5000/changeValue",
    RemoteSolveVersion=(0, 1, 0),
    ShowInput_Enabled=False,
    ShowInput_Path=False,
    SynchronousSolve=True)
negativeindexes = Hops(
    Integer=negative,
    CacheResultsInMemory=True,
    CacheSolveResults=True,
    RemoteDefinitionLocation="http://127.0.0.1:5000/negativeIndexes",
    RemoteSolveVersion=(0, 1, 0),
    ShowInput_Enabled=False,
    ShowInput_Path=False,
    SynchronousSolve=True)
slice = Hops(
    Integer=Slider(0, range=0..3),
    CacheResultsInMemory=True,
    CacheSolveResults=True,
    RemoteDefinitionLocation="http://127.0.0.1:5000/slice",
    RemoteSolveVersion=(0, 1, 0),
    ShowInput_Enabled=False,
    ShowInput_Path=False,
    SynchronousSolve=True)
panel_25 = Panel(list)
panel_26 = Panel(negativeindexes)
panel_27 = Panel(slice)
panel_28 = Panel(changevalue)
panel_29 = Panel(length3)
panel_30 = Panel(concatenation)
panel_31 = Panel(del)
# Working with Lists
boolean_toggle_2 = BooleanToggle(False)
append = Hops(
    Integer=boolean_toggle_2,
    CacheResultsInMemory=True,
    CacheSolveResults=True,
    RemoteDefinitionLocation="http://127.0.0.1:5000/append",
    RemoteSolveVersion=(0, 1, 0),
    ShowInput_Enabled=False,
    ShowInput_Path=False,
    SynchronousSolve=True)
in = Hops(
    Integer=Toggle(True),
    CacheResultsInMemory=True,
    CacheSolveResults=True,
    RemoteDefinitionLocation="http://127.0.0.1:5000/in",
    RemoteSolveVersion=(0, 1, 0),
    ShowInput_Enabled=False,
    ShowInput_Path=False,
    SynchronousSolve=True)
insert = Hops(
    Integer=Slider(2, range=0..3),
    CacheResultsInMemory=True,
    CacheSolveResults=True,
    RemoteDefinitionLocation="http://127.0.0.1:5000/insert",
    RemoteSolveVersion=(0, 1, 0),
    ShowInput_Enabled=False,
    ShowInput_Path=False,
    SynchronousSolve=True)
remove = Hops(
    Integer=Slider(2, range=0..3),
    CacheResultsInMemory=True,
    CacheSolveResults=True,
    RemoteDefinitionLocation="http://127.0.0.1:5000/remove",
    RemoteSolveVersion=(0, 1, 0),
    ShowInput_Enabled=False,
    ShowInput_Path=False,
    SynchronousSolve=True)
loop = Hops(
    Integer=Toggle(True),
    CacheResultsInMemory=True,
    CacheSolveResults=True,
    RemoteDefinitionLocation="http://127.0.0.1:5000/loop",
    RemoteSolveVersion=(0, 1, 0),
    ShowInput_Enabled=False,
    ShowInput_Path=False,
    SynchronousSolve=True)
not_in = Hops(
    Integer=Toggle(True),
    CacheResultsInMemory=True,
    CacheSolveResults=True,
    RemoteDefinitionLocation="http://127.0.0.1:5000/not_in",
    RemoteSolveVersion=(0, 1, 0),
    ShowInput_Enabled=False,
    ShowInput_Path=False,
    SynchronousSolve=True)
multiple_assignment = Hops(
    Integer=Toggle(False),
    CacheResultsInMemory=True,
    CacheSolveResults=True,
    RemoteDefinitionLocation="http://127.0.0.1:5000/multiple_assignment",
    RemoteSolveVersion=(0, 1, 0),
    ShowInput_Enabled=False,
    ShowInput_Path=False,
    SynchronousSolve=True)
enumerate = Hops(
    Integer=Toggle(True),
    CacheResultsInMemory=True,
    CacheSolveResults=True,
    RemoteDefinitionLocation="http://127.0.0.1:5000/_enumerate",
    RemoteSolveVersion=(0, 1, 0),
    ShowInput_Enabled=False,
    ShowInput_Path=False,
    SynchronousSolve=True)
random_choice = Hops(
    Integer=Toggle(True),
    CacheResultsInMemory=False,
    CacheSolveResults=False,
    RemoteDefinitionLocation="http://127.0.0.1:5000/random_choice",
    RemoteSolveVersion=(0, 1, 0),
    ShowInput_Enabled=False,
    ShowInput_Path=False,
    SynchronousSolve=True)
panel_32 = Panel(loop)
panel_33 = Panel(append)
panel_34 = Panel(insert)
panel_35 = Panel(in)
panel_36 = Panel(random_choice)
panel_37 = Panel(remove)
panel_38 = Panel(enumerate)
panel_39 = Panel(not_in)
panel_40 = Panel(multiple_assignment)
sorted3 = Hops(
    Number=Toggle(True),
    CacheResultsInMemory=True,
    CacheSolveResults=True,
    RemoteDefinitionLocation="http://127.0.0.1:5000/sorted3",
    RemoteSolveVersion=(0, 1, 0),
    ShowInput_Enabled=False,
    ShowInput_Path=False,
    SynchronousSolve=True)
reverse = Hops(
    Number=Toggle(True),
    CacheResultsInMemory=True,
    CacheSolveResults=True,
    RemoteDefinitionLocation="http://127.0.0.1:5000/reverse",
    RemoteSolveVersion=(0, 1, 0),
    ShowInput_Enabled=False,
    ShowInput_Path=False,
    SynchronousSolve=True)
mutable = Hops(
    Integer=Slider(1, range=0..2),
    CacheResultsInMemory=True,
    CacheSolveResults=True,
    RemoteDefinitionLocation="http://127.0.0.1:5000/mutable",
    RemoteSolveVersion=(0, 1, 0),
    ShowInput_Enabled=False,
    ShowInput_Path=False,
    SynchronousSolve=True)
magic8ball = Hops(
    Question=Toggle(False),
    CacheResultsInMemory=True,
    CacheSolveResults=True,
    RemoteDefinitionLocation="http://127.0.0.1:5000/magic8ball",
    RemoteSolveVersion=(0, 1, 0),
    ShowInput_Enabled=False,
    ShowInput_Path=False,
    SynchronousSolve=True)
immutable_error = Hops(
    Integer=Slider(1, range=0..2),
    CacheResultsInMemory=True,
    CacheSolveResults=True,
    RemoteDefinitionLocation="http://127.0.0.1:5000/immutable",
    RemoteSolveVersion=(0, 1, 0),
    ShowInput_Enabled=False,
    ShowInput_Path=False,
    SynchronousSolve=True)
tuples = Hops(
    Integer=Slider(1, range=0..2),
    CacheResultsInMemory=True,
    CacheSolveResults=True,
    RemoteDefinitionLocation="http://127.0.0.1:5000/tuples",
    RemoteSolveVersion=(0, 1, 0),
    ShowInput_Enabled=False,
    ShowInput_Path=False,
    SynchronousSolve=True)
immutable_fixed = Hops(
    Integer=Slider(1, range=0..2),
    CacheResultsInMemory=False,
    CacheSolveResults=False,
    RemoteDefinitionLocation="http://127.0.0.1:5000/immutable3",
    RemoteSolveVersion=(0, 1, 0),
    ShowInput_Enabled=False,
    ShowInput_Path=False,
    SynchronousSolve=True)
identity = Hops(
    Integer=Slider(0, range=0..2),
    CacheResultsInMemory=True,
    CacheSolveResults=True,
    RemoteDefinitionLocation="http://127.0.0.1:5000/identity",
    RemoteSolveVersion=(0, 1, 0),
    ShowInput_Enabled=False,
    ShowInput_Path=False,
    SynchronousSolve=True)
conway_s_game_of_life = Hops(
    Integer=Toggle(True),
    CacheResultsInMemory=True,
    CacheSolveResults=True,
    RemoteDefinitionLocation="http://127.0.0.1:5000/conway",
    RemoteSolveVersion=(0, 1, 0),
    ShowInput_Enabled=False,
    ShowInput_Path=False,
    SynchronousSolve=True)
panel_41 = Panel(identity)
panel_42 = Panel(immutable_fixed)
panel_43 = Panel(immutable_error)
panel_44 = Panel(mutable)
panel_45 = Panel(tuples)
panel_46 = Panel(sorted3)
panel_47 = Panel(reverse)
panel_48 = Panel(magic8ball)
# Dictionaries and Structuring Data
boolean_toggle_3 = BooleanToggle(True)
# Tic Tac Toe
boolean_toggle_4 = BooleanToggle(True)
# Nested Dictionaries and Lists
boolean_toggle_5 = BooleanToggle(True)
# import pprint
boolean_toggle_6 = BooleanToggle(True)
list_to_dict = Hops(
    Integer=Toggle(True),
    CacheResultsInMemory=True,
    CacheSolveResults=True,
    RemoteDefinitionLocation="http://127.0.0.1:5000/_list_to_dict",
    RemoteSolveVersion=(0, 1, 0),
    ShowInput_Enabled=False,
    ShowInput_Path=False,
    SynchronousSolve=True)
nested = Hops(
    Integer=Toggle(False),
    CacheResultsInMemory=True,
    CacheSolveResults=True,
    RemoteDefinitionLocation="http://127.0.0.1:5000/_nested",
    RemoteSolveVersion=(0, 1, 0),
    ShowInput_Enabled=False,
    ShowInput_Path=False,
    SynchronousSolve=True)
dictionary = Hops(
    Integer=boolean_toggle_3,
    CacheResultsInMemory=True,
    CacheSolveResults=True,
    RemoteDefinitionLocation="http://127.0.0.1:5000/dictionary",
    RemoteSolveVersion=(0, 1, 0),
    ShowInput_Enabled=False,
    ShowInput_Path=False,
    SynchronousSolve=True)
values4 = Hops(
    Integer=Toggle(False),
    CacheResultsInMemory=False,
    CacheSolveResults=False,
    RemoteDefinitionLocation="http://127.0.0.1:5000/_values4",
    RemoteSolveVersion=(0, 1, 0),
    ShowInput_Enabled=False,
    ShowInput_Path=False,
    SynchronousSolve=True)
keys4 = Hops(
    Integer=Toggle(True),
    CacheResultsInMemory=True,
    CacheSolveResults=True,
    RemoteDefinitionLocation="http://127.0.0.1:5000/_keys4",
    RemoteSolveVersion=(0, 1, 0),
    ShowInput_Enabled=False,
    ShowInput_Path=False,
    SynchronousSolve=True)
items4 = Hops(
    Integer=Toggle(True),
    CacheResultsInMemory=True,
    CacheSolveResults=True,
    RemoteDefinitionLocation="http://127.0.0.1:5000/_items4",
    RemoteSolveVersion=(0, 1, 0),
    ShowInput_Enabled=False,
    ShowInput_Path=False,
    SynchronousSolve=True)
in_2 = Hops(
    Integer=Toggle(True),
    CacheResultsInMemory=True,
    CacheSolveResults=True,
    RemoteDefinitionLocation="http://127.0.0.1:5000/_in",
    RemoteSolveVersion=(0, 1, 0),
    ShowInput_Enabled=False,
    ShowInput_Path=False,
    SynchronousSolve=True)
not_in_2 = Hops(
    Integer=Toggle(True),
    CacheResultsInMemory=True,
    CacheSolveResults=True,
    RemoteDefinitionLocation="http://127.0.0.1:5000/_not_in",
    RemoteSolveVersion=(0, 1, 0),
    ShowInput_Enabled=False,
    ShowInput_Path=False,
    SynchronousSolve=True)
get = Hops(
    Integer=Toggle(True),
    CacheResultsInMemory=True,
    CacheSolveResults=True,
    RemoteDefinitionLocation="http://127.0.0.1:5000/_get",
    RemoteSolveVersion=(0, 1, 0),
    ShowInput_Enabled=False,
    ShowInput_Path=False,
    SynchronousSolve=True)
setdefault = Hops(
    Integer=Toggle(True),
    CacheResultsInMemory=True,
    CacheSolveResults=True,
    RemoteDefinitionLocation="http://127.0.0.1:5000/_setdefault",
    RemoteSolveVersion=(0, 1, 0),
    ShowInput_Enabled=False,
    ShowInput_Path=False,
    SynchronousSolve=True)
setdefault2 = Hops(
    Integer=boolean_toggle_6,
    CacheResultsInMemory=True,
    CacheSolveResults=True,
    RemoteDefinitionLocation="http://127.0.0.1:5000/_setdefault2",
    RemoteSolveVersion=(0, 1, 0),
    ShowInput_Enabled=False,
    ShowInput_Path=False,
    SynchronousSolve=True)
pprint = Hops(
    Integer=boolean_toggle_4,
    CacheResultsInMemory=True,
    CacheSolveResults=True,
    RemoteDefinitionLocation="http://127.0.0.1:5000/_pprint",
    RemoteSolveVersion=(0, 1, 0),
    ShowInput_Enabled=False,
    ShowInput_Path=False,
    SynchronousSolve=True)
board = Hops(
    Integer=boolean_toggle_5,
    CacheResultsInMemory=True,
    CacheSolveResults=True,
    RemoteDefinitionLocation="http://127.0.0.1:5000/_board",
    RemoteSolveVersion=(0, 1, 0),
    ShowInput_Enabled=False,
    ShowInput_Path=False,
    SynchronousSolve=True)
panel_49 = Panel(dictionary)
panel_50 = Panel(list_to_dict)
panel_51 = Panel(not_in_2)
panel_52 = Panel(get)
panel_53 = Panel(values4)
panel_54 = Panel(in_2)
panel_55 = Panel(nested)
panel_56 = Panel(setdefault)
panel_57 = Panel(setdefault2)
panel_58 = Panel(keys4)
panel_59 = Panel(items4)
panel_60 = Panel(pprint)
panel_61 = Panel(board)
# Manipulating Strings
boolean_toggle_7 = BooleanToggle(False)
# note the return output in .gh panel (\\')
boolean_toggle_8 = BooleanToggle(False)

ljust_rjust = Hops(
    String=Toggle(True),
    CacheResultsInMemory=True,
    CacheSolveResults=True,
    RemoteDefinitionLocation="http://127.0.0.1:5000/_ljust_rjust",
    RemoteSolveVersion=(0, 1, 0),
    ShowInput_Enabled=False,
    ShowInput_Path=False,
    SynchronousSolve=True)  # -> Ljust, Rjust, Center, Rjust2, Center2
panel_62 = Panel([ljust_rjust.Ljust, ljust_rjust.Rjust, ljust_rjust.Center, ljust_rjust.Rjust2, ljust_rjust.Center2])

# ----
# no module names paperclip available
boolean_toggle_9 = BooleanToggle(True)

panel_63 = Panel("1234")
in_not_in = Hops(
    Integer=Toggle(False),
    CacheResultsInMemory=True,
    CacheSolveResults=True,
    RemoteDefinitionLocation="http://127.0.0.1:5000/_in_not_in",
    RemoteSolveVersion=(0, 1, 0),
    ShowInput_Enabled=False,
    ShowInput_Path=False,
    SynchronousSolve=True)  # -> StringIn, StringNotIn
isx_methods = Hops(
    Integer=Toggle(False),
    CacheResultsInMemory=True,
    CacheSolveResults=True,
    RemoteDefinitionLocation="http://127.0.0.1:5000/_isx_methods",
    RemoteSolveVersion=(0, 1, 0),
    ShowInput_Enabled=False,
    ShowInput_Path=False,
    SynchronousSolve=True)  # -> Isalpha, Isalnum, Isdecimal, Isspace, Istitle, Startswith, Endswith
index_slice = Hops(
    Integer=Toggle(False),
    CacheResultsInMemory=True,
    CacheSolveResults=True,
    RemoteDefinitionLocation="http://127.0.0.1:5000/_index_slice",
    RemoteSolveVersion=(0, 1, 0),
    ShowInput_Enabled=False,
    ShowInput_Path=False,
    SynchronousSolve=True)  # -> String0, String1, String2, String3, String4, String5, String6
useful_str_methods = Hops(
    Integer=Toggle(False),
    CacheResultsInMemory=True,
    CacheSolveResults=True,
    RemoteDefinitionLocation="http://127.0.0.1:5000/_useful_str_methods",
    RemoteSolveVersion=(0, 1, 0),
    ShowInput_Enabled=False,
    ShowInput_Path=False,
    SynchronousSolve=True)  # -> Upper, Lower, Isupper, Islower
validate_input_data = Hops(
    String="This is a string.",
    CacheResultsInMemory=True,
    CacheSolveResults=True,
    RemoteDefinitionLocation="http://127.0.0.1:5000/_validate_input_data",
    RemoteSolveVersion=(0, 1, 0),
    ShowInput_Enabled=False,
    ShowInput_Path=False,
    SynchronousSolve=True)
# view in termainal
escape_characters = Hops(
    Integer=boolean_toggle_7,
    CacheResultsInMemory=False,
    CacheSolveResults=False,
    RemoteDefinitionLocation="http://127.0.0.1:5000/_escape_characters",
    RemoteSolveVersion=(0, 1, 0),
    ShowInput_Enabled=False,
    ShowInput_Path=False,
    SynchronousSolve=True)
raw_strings = Hops(
    Integer=boolean_toggle_8,
    CacheResultsInMemory=True,
    CacheSolveResults=True,
    RemoteDefinitionLocation="http://127.0.0.1:5000/_raw_strings",
    RemoteSolveVersion=(0, 1, 0),
    ShowInput_Enabled=False,
    ShowInput_Path=False,
    SynchronousSolve=True)
str_inside_str = Hops(
    Integer=Toggle(False),
    CacheResultsInMemory=True,
    CacheSolveResults=True,
    RemoteDefinitionLocation="http://127.0.0.1:5000/_str_inside_str",
    RemoteSolveVersion=(0, 1, 0),
    ShowInput_Enabled=False,
    ShowInput_Path=False,
    SynchronousSolve=True)
f_strings = Hops(
    Integer=Toggle(False),
    CacheResultsInMemory=True,
    CacheSolveResults=True,
    RemoteDefinitionLocation="http://127.0.0.1:5000/_f_strings",
    RemoteSolveVersion=(0, 1, 0),
    ShowInput_Enabled=False,
    ShowInput_Path=False,
    SynchronousSolve=True)
startswith_endswith = Hops(
    String="Hello Man?",
    CacheResultsInMemory=True,
    CacheSolveResults=True,
    RemoteDefinitionLocation="http://127.0.0.1:5000/_startswith_endswith",
    RemoteSolveVersion=(0, 1, 0),
    ShowInput_Enabled=False,
    ShowInput_Path=False,
    SynchronousSolve=True)  # -> Startswith, Endswith
join_split = Hops(
    String=Toggle(True),
    CacheResultsInMemory=True,
    CacheSolveResults=True,
    RemoteDefinitionLocation="http://127.0.0.1:5000/_join_split",
    RemoteSolveVersion=(0, 1, 0),
    ShowInput_Enabled=False,
    ShowInput_Path=False,
    SynchronousSolve=True)  # -> Join, Split
partition_rpartition = Hops(
    String=Toggle(True),
    CacheResultsInMemory=True,
    CacheSolveResults=True,
    RemoteDefinitionLocation="http://127.0.0.1:5000/_partition_rpartition",
    RemoteSolveVersion=(0, 1, 0),
    ShowInput_Enabled=False,
    ShowInput_Path=False,
    SynchronousSolve=True)  # -> Partition, Rpartition
strip_rstrip_lstrip = Hops(
    String=Toggle(True),
    CacheResultsInMemory=True,
    CacheSolveResults=True,
    RemoteDefinitionLocation="http://127.0.0.1:5000/_strip_rstrip_lstrip",
    RemoteSolveVersion=(0, 1, 0),
    ShowInput_Enabled=False,
    ShowInput_Path=False,
    SynchronousSolve=True)  # -> _strip, _rstrip, _lstrip
ord_chr = Hops(
    String=Toggle(True),
    CacheResultsInMemory=True,
    CacheSolveResults=True,
    RemoteDefinitionLocation="http://127.0.0.1:5000/_ord_chr",
    RemoteSolveVersion=(0, 1, 0),
    ShowInput_Enabled=False,
    ShowInput_Path=False,
    SynchronousSolve=True)  # -> Ord, Chr
panel_64 = Panel([useful_str_methods.Upper, useful_str_methods.Lower, useful_str_methods.Isupper, useful_str_methods.Islower])
panel_65 = Panel(raw_strings)
panel_66 = Panel([index_slice.String0, index_slice.String1, index_slice.String2, index_slice.String3, index_slice.String4, index_slice.String5, index_slice.String6])
panel_67 = Panel([in_not_in.StringIn, in_not_in.StringNotIn])
panel_68 = Panel(str_inside_str)
panel_69 = Panel(f_strings)
panel_70 = Panel(validate_input_data)
panel_71 = Panel([isx_methods.Isalpha, isx_methods.Isalnum, isx_methods.Isdecimal, isx_methods.Isspace, isx_methods.Istitle, isx_methods.Startswith, isx_methods.Endswith])
panel_72 = Panel(partition_rpartition.Rpartition)
panel_73 = Panel([startswith_endswith.Startswith, startswith_endswith.Endswith])
panel_74 = Panel([join_split.Join, join_split.Split])
panel_75 = Panel(partition_rpartition.Partition)
panel_76 = Panel(escape_characters)
panel_77 = Panel([strip_rstrip_lstrip._strip, strip_rstrip_lstrip._rstrip, strip_rstrip_lstrip._lstrip])
panel_78 = Panel([ord_chr.Ord, ord_chr.Chr])
# Short Programs on the gh Canvas
# Oscar was running all over his nose
panel_79 = Panel("Max eats potatoes on a Sunday")
panel_80 = Panel()
# Guessing Game
panel_81 = Panel("3")
guessing_game = Hops(
    String=Slider(6, range=0..20),
    CacheResultsInMemory=True,
    CacheSolveResults=True,
    RemoteDefinitionLocation="http://127.0.0.1:5000/_guessing_game",
    RemoteSolveVersion=(0, 1, 0),
    ShowInput_Enabled=False,
    ShowInput_Path=False,
    SynchronousSolve=True)
# Caesar cipher
caesar_cipher = Hops(
    String=panel_80,
    CacheResultsInMemory=True,
    CacheSolveResults=True,
    RemoteDefinitionLocation="http://127.0.0.1:5000/_caesar_cipher",
    RemoteSolveVersion=(0, 1, 0),
    ShowInput_Enabled=False,
    ShowInput_Path=False,
    SynchronousSolve=True)
# Pig Latin
pig_latin2 = Hops(
    String=panel_79,
    CacheResultsInMemory=True,
    CacheSolveResults=True,
    RemoteDefinitionLocation="http://127.0.0.1:5000/_pig_latin2",
    RemoteSolveVersion=(0, 1, 0),
    ShowInput_Enabled=False,
    ShowInput_Path=False,
    SynchronousSolve=True)
panel_82 = Panel(pig_latin2)
panel_83 = Panel(caesar_cipher)
panel_84 = Panel(guessing_game)
# PATTERN MATCHING
# WITH REGULAR
# EXPRESSIONS
panel_85 = Panel("413-555-1234")
panel_86 = Panel("549-943-1234")
# # Review of Regex Symbols
# """
# The ? matches zero or one of the preceding group.
# The * matches zero or more of the preceding group.
# The + matches one or more of the preceding group.
# The {n} matches exactly n of the preceding group.
# The {n,} matches n or more of the preceding group.
# The {,m} matches 0 to m of the preceding group.
# The {n,m} matches at least n and at most m of the preceding group.
# {n,m}? or *? or +? performs a non-greedy match of the preceding group.
# ^spam means the string must begin with spam.
# spam$ means the string must end with spam.
# The . matches any character, except newline characters.
# \d, \w, and \s match a digit, word, or space character, respectively.
# \D, \W, and \S match anything except a digit, word, or space character, respectively.
# [abc] matches any character between the brackets (such as a, b, or c).
# [^abc] matches any character that isn’t between the brackets.
# """
panel_87 = Panel("he Adventures of Batwoman")
# Project: strong_password
panel_88 = Panel("HappyShoe12344321!")

# ----
# Project: phone_email
panel_89 = Panel()
phone_email = Hops(
    Text=panel_89,
    CacheResultsInMemory=True,
    CacheSolveResults=True,
    RemoteDefinitionLocation="http://127.0.0.1:5000/phone_email",
    RemoteSolveVersion=(0, 1, 0),
    ShowInput_Enabled=False,
    ShowInput_Path=False,
    SynchronousSolve=True)
panel_90 = Panel(phone_email)

panel_92 = Panel("abcd")
is_phone_number = Hops(
    Text=panel_85,
    CacheResultsInMemory=True,
    CacheSolveResults=True,
    RemoteDefinitionLocation="http://127.0.0.1:5000/is_phone_number",
    RemoteSolveVersion=(0, 1, 0),
    ShowInput_Enabled=False,
    ShowInput_Path=False,
    SynchronousSolve=True)
grouping = Hops(
    Text="413-555-1234",
    CacheResultsInMemory=True,
    CacheSolveResults=True,
    RemoteDefinitionLocation="http://127.0.0.1:5000/grouping",
    RemoteSolveVersion=(0, 1, 0),
    ShowInput_Enabled=False,
    ShowInput_Path=False,
    SynchronousSolve=True)  # -> Phone_number, Area_code, All_group, All_groups
findall = Hops(
    Text="413-555-1234",
    CacheResultsInMemory=True,
    CacheSolveResults=True,
    RemoteDefinitionLocation="http://127.0.0.1:5000/findall",
    RemoteSolveVersion=(0, 1, 0),
    ShowInput_Enabled=False,
    ShowInput_Path=False,
    SynchronousSolve=True)
pipe7 = Hops(
    Text="r'Batman|Tina Fey'",
    CacheResultsInMemory=True,
    CacheSolveResults=True,
    RemoteDefinitionLocation="http://127.0.0.1:5000/pipe7",
    RemoteSolveVersion=(0, 1, 0),
    ShowInput_Enabled=False,
    ShowInput_Path=False,
    SynchronousSolve=True)
batmobile = Hops(
    Text="Batmobile lost a wheel",
    CacheResultsInMemory=True,
    CacheSolveResults=True,
    RemoteDefinitionLocation="http://127.0.0.1:5000/batmobile",
    RemoteSolveVersion=(0, 1, 0),
    ShowInput_Enabled=False,
    ShowInput_Path=False,
    SynchronousSolve=True)
phone_numbers_without_area_code = Hops(
    Text="943-1234",
    CacheResultsInMemory=True,
    CacheSolveResults=True,
    RemoteDefinitionLocation="http://127.0.0.1:5000/phone_numbers_without_area_code",
    RemoteSolveVersion=(0, 1, 0),
    ShowInput_Enabled=False,
    ShowInput_Path=False,
    SynchronousSolve=True)
one_or_more = Hops(
    Text=panel_87,
    CacheResultsInMemory=True,
    CacheSolveResults=True,
    RemoteDefinitionLocation="http://127.0.0.1:5000/one_or_more",
    RemoteSolveVersion=(0, 1, 0),
    ShowInput_Enabled=False,
    ShowInput_Path=False,
    SynchronousSolve=True)
questionmark = Hops(
    Text="The Adventures of Batman",
    CacheResultsInMemory=True,
    CacheSolveResults=True,
    RemoteDefinitionLocation="http://127.0.0.1:5000/questionmark",
    RemoteSolveVersion=(0, 1, 0),
    ShowInput_Enabled=False,
    ShowInput_Path=False,
    SynchronousSolve=True)
star = Hops(
    Text="he Adventures of Batwowowowoman",
    CacheResultsInMemory=True,
    CacheSolveResults=True,
    RemoteDefinitionLocation="http://127.0.0.1:5000/star",
    RemoteSolveVersion=(0, 1, 0),
    ShowInput_Enabled=False,
    ShowInput_Path=False,
    SynchronousSolve=True)
strong_password = Hops(
    Text=panel_88,
    CacheResultsInMemory=True,
    CacheSolveResults=True,
    RemoteDefinitionLocation="http://127.0.0.1:5000/strong_password",
    RemoteSolveVersion=(0, 1, 0),
    ShowInput_Enabled=False,
    ShowInput_Path=False,
    SynchronousSolve=True)
panel_93 = Panel(is_phone_number)
panel_94 = Panel([grouping.Phone_number, grouping.Area_code, grouping.All_group, grouping.All_groups])
panel_95 = Panel(phone_numbers_without_area_code)
panel_96 = Panel(findall)
panel_97 = Panel(pipe7)
panel_98 = Panel(questionmark)
panel_99 = Panel(batmobile)
panel_100 = Panel(star)
panel_101 = Panel(strong_password)
panel_102 = Panel(one_or_more)
# Input Validation
number_slider_5 = Slider(2, range=-5..5)

input_num = Hops(
    Text=Toggle(False),
    CacheResultsInMemory=False,
    CacheSolveResults=False,
    RemoteDefinitionLocation="http://127.0.0.1:5000/input_num",
    RemoteSolveVersion=(0, 1, 0),
    ShowInput_Enabled=False,
    ShowInput_Path=False,
    SynchronousSolve=True)  # disabled
keep_an_idiot_busy_for_hours = Hops(
    Text=Toggle(False),
    CacheResultsInMemory=False,
    CacheSolveResults=False,
    RemoteDefinitionLocation="http://127.0.0.1:5000/keep_an_idiot_busy_for_hours",
    RemoteSolveVersion=(0, 1, 0),
    ShowInput_Enabled=False,
    ShowInput_Path=False,
    SynchronousSolve=True)  # disabled
hops = Hops(
    Text=Slider(50, range=0..100),
    CacheResultsInMemory=False,
    CacheSolveResults=False,
    RemoteDefinitionLocation="http://127.0.0.1:5000/multiplication_quiz",
    RemoteSolveVersion=(0, 1, 0),
    ShowInput_Enabled=False,
    ShowInput_Path=False,
    SynchronousSolve=True)  # disabled
panel_103 = Panel(keep_an_idiot_busy_for_hours)
panel_104 = Panel(hops)
panel_105 = Panel(input_num)

positive_integer = Hops(
    Text=number_slider_5,
    CacheResultsInMemory=False,
    CacheSolveResults=False,
    RemoteDefinitionLocation="http://127.0.0.1:5000/positive_integer",
    RemoteSolveVersion=(0, 1, 0),
    ShowInput_Enabled=False,
    ShowInput_Path=False,
    SynchronousSolve=True)
your_age = Hops(
    Text=Slider(2, range=-5..5),
    CacheResultsInMemory=True,
    CacheSolveResults=True,
    RemoteDefinitionLocation="http://127.0.0.1:5000/your_age",
    RemoteSolveVersion=(0, 1, 0),
    ShowInput_Enabled=False,
    ShowInput_Path=False,
    SynchronousSolve=True)
panel_106 = Panel(positive_integer)
panel_107 = Panel(your_age)

create_new_folder = Hops(
    Text="spamMichael",
    CacheResultsInMemory=False,
    CacheSolveResults=False,
    RemoteDefinitionLocation="http://127.0.0.1:5000/create_new_folder",
    RemoteSolveVersion=(0, 1, 0),
    ShowInput_Enabled=False,
    ShowInput_Path=False,
    SynchronousSolve=True)
panel_108 = Panel(create_new_folder)

handle_abs_rel_path = Hops(
    Text="spamMichael",
    CacheResultsInMemory=False,
    CacheSolveResults=False,
    RemoteDefinitionLocation="http://127.0.0.1:5000/handle_abs_rel_path",
    RemoteSolveVersion=(0, 1, 0),
    ShowInput_Enabled=False,
    ShowInput_Path=False,
    SynchronousSolve=True)
panel_109 = Panel(handle_abs_rel_path)

get_parts_file_path = Hops(
    Text="spamMichael",
    CacheResultsInMemory=False,
    CacheSolveResults=False,
    RemoteDefinitionLocation="http://127.0.0.1:5000/get_parts_file_path",
    RemoteSolveVersion=(0, 1, 0),
    ShowInput_Enabled=False,
    ShowInput_Path=False,
    SynchronousSolve=True)
panel_110 = Panel(get_parts_file_path)

# ----
# Reading and Writing Files
panel_111 = Panel("spam")
current_working_dir = Hops(
    Text=Toggle(True),
    CacheResultsInMemory=True,
    CacheSolveResults=True,
    RemoteDefinitionLocation="http://127.0.0.1:5000/current_working_dir",
    RemoteSolveVersion=(0, 1, 0),
    ShowInput_Enabled=False,
    ShowInput_Path=False,
    SynchronousSolve=True)
backslashes_windows = Hops(
    Text="AECTech",
    CacheResultsInMemory=False,
    CacheSolveResults=False,
    RemoteDefinitionLocation="http://127.0.0.1:5000/backslashes_windows",
    RemoteSolveVersion=(0, 1, 0),
    ShowInput_Enabled=False,
    ShowInput_Path=False,
    SynchronousSolve=True)
abs_rel_path = Hops(
    Text="spam",
    CacheResultsInMemory=False,
    CacheSolveResults=False,
    RemoteDefinitionLocation="http://127.0.0.1:5000/abs_rel_path",
    RemoteSolveVersion=(0, 1, 0),
    ShowInput_Enabled=False,
    ShowInput_Path=False,
    SynchronousSolve=True)
home_dir = Hops(
    Text=Toggle(True),
    CacheResultsInMemory=True,
    CacheSolveResults=True,
    RemoteDefinitionLocation="http://127.0.0.1:5000/home_dir",
    RemoteSolveVersion=(0, 1, 0),
    ShowInput_Enabled=False,
    ShowInput_Path=False,
    SynchronousSolve=True)
panel_112 = Panel(current_working_dir)
panel_113 = Panel(home_dir)
find_files = Hops(
    Text="spamMichael",
    CacheResultsInMemory=True,
    CacheSolveResults=True,
    RemoteDefinitionLocation="http://127.0.0.1:5000/find_files",
    RemoteSolveVersion=(0, 1, 0),
    ShowInput_Enabled=False,
    ShowInput_Path=False,
    SynchronousSolve=True)  # -> Text, ListOut

panel_114 = Panel([find_files.Text, find_files.ListOut])
